# Grasshopper definition ex.gh (Grasshopper 0.9.76)
# plug-ins: Exoskeleton, Weaverbird

mesh = Mesh(<mesh referenced from the Rhino model>)  # disabled
mesh_2 = Mesh(<mesh referenced from the Rhino model>)
number_slider = Slider(0.02, range=0..0.1)
wbedges = WeaverbirdsMeshEdges(MeshOrPolylines=mesh)
wbedges_2 = WeaverbirdsMeshEdges(MeshOrPolylines=mesh_2)
exo = Exoskeleton(
    Lines=wbedges,
    Sides=Slider(8, range=0..10),
    Thickness=number_slider,
    NodeSize=number_slider,
    Knuckle=0.1,
    Spacing=3,
    Open=False)
exo_2 = Exoskeleton(
    Lines=wbedges_2,
    Sides=Slider(4, range=0..10),
    Thickness=Slider(0.02, range=0..0.1),
    NodeSize=Slider(0.1, range=0..0.1),
    Knuckle=0.1,
    Spacing=3,
    Open=False)
wbcatmullclark = WeaverbirdsCatmullClarkSubdivision(MeshCurves=exo, Level=Slider(3, range=0..10), SmoothNakedEdges=1)
wbcatmullclark_2 = WeaverbirdsCatmullClarkSubdivision(MeshCurves=exo_2, Level=Slider(3, range=0..10), SmoothNakedEdges=1)  # disabled
