# Grasshopper definition hand.gh (Grasshopper 0.9.76)
# plug-ins: LunchBox

xy_plane = XYPlane(Origin=Point(0, 0, 0))
geometry = Geometry(<brep referenced from the Rhino model>)
scale = Scale(Geometry=geometry, Center=Point(0, 0, 0), Factor=Slider(0.2, range=0..1))  # -> Geometry, Transform
surface = Surface(<surface referenced from the Rhino model>)
surface_frames = SurfaceFrames(Surface=surface, UCount=Slider(20, range=0..20), VCount=Slider(20, range=0..20))  # -> Frames, Parameters
data = Data(surface_frames.Frames)
panel = Panel("""0
-1""")
viewer = ParamViewer(data)
cull_i = CullIndex(List=viewer, Indices=panel, Wrap=True)
branch = TreeBranch(Tree=data, Path=cull_i, MaintainPaths=True)
flip = FlipMatrix(Data=branch)
viewer_2 = ParamViewer(flip)
cull_i_2 = CullIndex(List=viewer_2, Indices=panel, Wrap=True)
branch_2 = TreeBranch(Tree=flip, Path=cull_i_2, MaintainPaths=True)
orient = Orient(Geometry=scale.Geometry, Source=xy_plane, Target=branch_2)  # -> Geometry, Transform
deconstruct_plane = DeconstructPlane(Plane=flatten(branch_2))  # -> Origin, XAxis, YAxis, ZAxis
geometry_2 = Geometry(flatten(orient.Geometry))
point = Point(Point(15.28631257, 0.9345563401, 12.18351531))
distance = Distance(PointA=deconstruct_plane.Origin, PointB=point)
sort_list = SortList(Keys=distance)  # -> Keys, ValuesA
reverse_list = ReverseList(List=sort_list.Keys)
list_item = ListItem(List=reverse_list, Index=0, Wrap=True)
list_item_2 = ListItem(List=sort_list.Keys, Index=0, Wrap=True)
gradient = Gradient(
    LowerLimit=list_item_2,
    UpperLimit=list_item,
    Parameter=distance,
    stops=[0: RGB(255, 255, 255), 0.437: RGB(128, 128, 128), 1: RGB(0, 0, 0)])
split_argb = SplitARGB(Colour=gradient)  # -> Alpha, Red, Green, Blue
multiplication = Multiplication(A=split_argb.Red, B=Slider(1, range=0..10))
addition = Addition(A=multiplication, B=0.2)
scale_2 = Scale(Geometry=geometry_2, Center=deconstruct_plane.Origin, Factor=addition)  # -> Geometry, Transform
panel_2 = Panel(split_argb.Green)
object_bake = ObjectBake(
    BakeToggle=Button(),
    GeometryObjects=scale_2.Geometry,
    Layer="GH_Bake",
    ObjectName=gradient,
    ObjectColor=gradient,
    LayerColor=RGB(255, 255, 255))
custom_preview = CustomPreview(Geometry=scale_2.Geometry, Shader=gradient)
