# Grasshopper definition head.gh (Grasshopper 0.9.76)
# plug-ins: LunchBox, Weaverbird

number_slider = Slider(90, range=0..100)
srf = Surface(reparameterize(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))
sdivide = DivideSurface(Surface=srf, UCount=number_slider, VCount=number_slider)  # -> Points, Normals, Parameters
graph = GraphMapper(
    sdivide.Parameters,
    x0=0,
    x1=1,
    y0=0,
    y1=1,
    container_name="Bezier",
    cpx=[0, 0.6503627896, 0.4782613218, 1],
    cpy=[0, 0.3079710007, 0.5978261232, 1])
evalsrf = EvaluateSurface(Surface=srf, Point=graph)  # -> Point, Normal, Frame
number_slider_2 = Slider(10, range=10..50)
number_slider_3 = Slider(10, range=10..50)
addition = Addition(A=number_slider, B=1)
srfgrid = SurfaceFromPoints(Points=flatten(evalsrf.Point), UCount=addition, Interpolate=False)
hex = HexagonCells(Surface=srfgrid, UDivisions=Slider(4, range=0..10), VDivisions=Slider(1, range=0..10), TParameter=0.25)  # -> HexagonCells, Centers
crv = Curve(hex.HexagonCells)
wbcatmullclark = WeaverbirdsCatmullClarkSubdivision(MeshCurves=crv, Level=1, SmoothNakedEdges=1)
wbframe = WeaverbirdsPictureFrame(MeshPolylines=wbcatmullclark, Distance=Slider(10, range=0..10), InsetType=0)
wbthicken = WeaverbirdsMeshThicken(MeshCurves=wbframe, Distance=Slider(0.5, range=0..1), OffsetType=0)
wbcatmullclark_2 = WeaverbirdsCatmullClarkSubdivision(MeshCurves=wbthicken, Level=3, SmoothNakedEdges=1)
