# Grasshopper definition lamp.gh (Grasshopper 0.9.76)

radgrid = Radial(Plane=PlaneXY(0, 0, 0), Size=Slider(5, range=0..10), ExtentR=Slider(7, range=0..10), ExtentP=Slider(48, range=10..160))  # -> Cells, Points
viewer = ParamViewer(radgrid.Cells)
crv = Curve(radgrid.Cells)
sift = SiftPattern(List=crv, SiftPattern=[0, 0, 1, 1])  # -> Output0, Output1
dispatch = Dispatch(List=sift.Output0, DispatchPattern=[True, False])  # -> ListA, ListB
dispatch_2 = Dispatch(List=sift.Output1, DispatchPattern=[False, True])  # -> ListA, ListB
crv_2 = Curve(dispatch_2.ListA)
crv_3 = Curve(dispatch.ListA)
crv_4 = Curve(dispatch_2.ListB)
crv_5 = Curve(dispatch.ListB)
flip = FlipMatrix(Data=crv_2)
flip_2 = FlipMatrix(Data=crv_5)
flip_3 = FlipMatrix(Data=crv_3)
flip_4 = FlipMatrix(Data=crv_4)
dispatch_3 = Dispatch(List=flip_2, DispatchPattern=[False, True])  # -> ListA, ListB
dispatch_4 = Dispatch(List=flip, DispatchPattern=[False, True])  # -> ListA, ListB
dispatch_5 = Dispatch(List=flip_3, DispatchPattern=[False, True])  # -> ListA, ListB
dispatch_6 = Dispatch(List=flip_4, DispatchPattern=[False, True])  # -> ListA, ListB
crv_6 = Curve(dispatch_3.ListA)
crv_7 = Curve(dispatch_5.ListB)
crv_8 = Curve(dispatch_4.ListA)
crv_9 = Curve(dispatch_6.ListB)
data = Data([crv_7, crv_8, crv_6, crv_9])
len = Length(Curve=data)
area = Area(Geometry=data)  # -> Area, Centroid
division = Division(A=len, B=Slider(10, range=0..10))
panel = Panel(data)
cir = Circle(Plane=area.Centroid, Radius=division)
boundary = BoundarySurfaces(Edges=flatten(cir))
