# Grasshopper definition moebius_developable2.gh (Grasshopper 0.9.76)
# plug-ins: MeshEdit Components, Kangaroo Components, Weaverbird

width = Slider(8.995, range=0..20)
cir = Circle(Plane=PlaneXY(0, 0, 0), Radius=20)
pframes = PerpFrames(Curve=cir, Count=100, Align=True)  # -> Frames, Parameters
division = Division(A=Slider(3, range=1..5), B=2)
cir_2 = Circle(Plane=pframes.Frames, Radius=width)
range = Range(Domain=division, Steps=100)
addition = Addition(A=range, B=0.5)
item = ListItem(List=cir_2, Index=0, Wrap=True)
mod = Modulus(A=addition, B=1)
mod_2 = Modulus(A=range, B=1)
loft = Loft(Curves=cir_2, Options={Adjust=False, Closed=True, LoftEnds=0, LoftSimp=0, LoftType=0, Rebuild=10, Refit=0.01})
eval = EvaluateCurve(Curve=reparameterize([cir_2, item]), Parameter=mod_2)  # -> Point, Tangent, Angle
eval_2 = EvaluateCurve(Curve=reparameterize([cir_2, item]), Parameter=mod)  # -> Point, Tangent, Angle
panel = Panel(mod)
ln = Line(StartPoint=eval.Point, EndPoint=eval_2.Point)
divide = DivideCurve(Curve=ln, Count=10, Kinks=False)  # -> Points, Tangents, Parameters
frompoints = MeshFromPoints(Points=flatten(divide.Points), UDirection=101, VDirection=11)
clean = CombineClean(Meshes=frompoints)
warpweft = WarpWeft(Mesh=clean)  # -> Warp, Weft, NakedA, NakedB
faceb = FaceBoundaries(Mesh=clean)
len = Length(Curve=warpweft.Warp)
len_2 = Length(Curve=warpweft.Weft)
explode = Explode(Curve=faceb, Recursive=True)  # -> Segments, Vertices
avr = Average(Input=len)
avr_2 = Average(Input=len_2)
item_2 = ListItem(List=explode.Vertices, Index=0, Wrap=True)  # -> Item, Item1, Item2
sqr = Square(Value=avr_2)
sqr_2 = Square(Value=avr)
ln_2 = Line(StartPoint=item_2.Item, EndPoint=item_2.Item2)
smooth = MeshSmooth(mesh=clean, strength=100)
addition_2 = Addition(A=sqr_2, B=sqr)
sqrt = SquareRoot(Value=addition_2)
springs = SpringsFromLine(Connection=ln_2, Stiffness=2000, Damping=10, RestLength=sqrt, UpperCutoff=0, LowerCutoff=0, Plasticity=0)
springs_2 = SpringsFromLine(Connection=warpweft.Warp, Stiffness=2000, Damping=10, RestLength=avr, UpperCutoff=0, LowerCutoff=0, Plasticity=0)
springs_3 = SpringsFromLine(Connection=warpweft.Weft, Stiffness=2000, Damping=10, RestLength=avr_2, UpperCutoff=0, LowerCutoff=0, Plasticity=0)
kangaroo = KangarooPhysics(ForceObjects=flatten([springs_2, springs, smooth, springs_3]), Settings=null, Geometry=clean, SimulationReset=True)  # -> Out, Iterations, ParticlesOut, GeometryOut, KE
mesh = Mesh(kangaroo.GeometryOut)
wbedges = WeaverbirdsMeshEdges(MeshOrPolylines=mesh)

# ==== cluster MeshSmooth: Apply Laplacian Smoothing to a mesh
mesh = ClusterInput()
mesh_2 = Mesh(mesh)
nv = NakedVertices(Mesh=mesh_2)  # -> Clothed, Naked, ClothedPts, NakedPts
vn = VertexNeighbours(Mesh=mesh_2, VertexNumber=nv.Clothed)  # -> Vertex, Neighbours, Normal
strength = ClusterInput()
laplacian = Laplacian(Center=graft(vn.Vertex), Neighbours=vn.Neighbours, Strength=strength, Weighting=0)  # -> flatten(Laplacian)
L = ClusterOutput(laplacian)
