# Grasshopper definition moebius_nat.gh (Grasshopper 0.9.76)
# plug-ins: Kangaroo Components

number_slider = Slider(50, range=4..100)
number_slider_2 = Slider(37, range=4..100)
width = Slider(15, range=0..20)
cir = Circle(Plane=PlaneXY(0, 0, 0), Radius=Slider(50, range=4..100))
pframes = PerpFrames(Curve=cir, Count=number_slider, Align=True)  # -> Frames, Parameters
division = Division(A=Slider(12, range=1..13), B=2)
cir_2 = Circle(Plane=pframes.Frames, Radius=width)
range = Range(Domain=division, Steps=number_slider)
bbox = BoundingBox(Content=cir_2, Plane=PlaneXY(0, 0, 0), UnionBox=True)  # -> Box, Box_2
addition = Addition(A=range, B=0.5)
item = ListItem(List=cir_2, Index=0, Wrap=True)
debrep = DeconstructBrep(Brep=bbox.Box_2)  # -> Faces, Edges, Vertices
mod = Modulus(A=addition, B=1)
mod_2 = Modulus(A=range, B=1)
loft = Loft(Curves=cir_2, Options={Adjust=False, Closed=True, LoftEnds=0, LoftSimp=0, LoftType=0, Rebuild=10, Refit=0.01})
item_2 = ListItem(List=debrep.Edges, Index=0, Wrap=True)
eval = EvaluateCurve(Curve=reparameterize([cir_2, item]), Parameter=mod_2)  # -> Point, Tangent, Angle
eval_2 = EvaluateCurve(Curve=reparameterize([cir_2, item]), Parameter=mod)  # -> Point, Tangent, Angle
len = Length(Curve=item_2)
pipe = Pipe(Curve=cir_2, Radius=0.3, Caps=0)
ln = Line(StartPoint=eval.Point, EndPoint=eval_2.Point)
addition_2 = Addition(A=number_slider, B=1)
divide = DivideCurve(Curve=ln, Count=10, Kinks=False)  # -> Points, Tangents, Parameters
loft_2 = Loft(Curves=ln, Options={Adjust=False, Closed=False, LoftEnds=0, LoftSimp=0, LoftType=0, Rebuild=10, Refit=0.01})
dupln = RemoveDuplicateLines(Lines=ln, Tolerance=0.01)
panel = Panel(len)
preview = CustomPreview(Geometry=pipe, Shader=ColourSwatch(SwatchColor=RGB(135, 135, 135)))
dupln_2 = RemoveDuplicateLines(Lines=dupln, Tolerance=0.01)
pt = Point(Point(51, 0, 0))
loft_3 = Loft(Curves=dupln, Options={Adjust=False, Closed=True, LoftEnds=0, LoftSimp=0, LoftType=0, Rebuild=10, Refit=0.01})
debrep_2 = DeconstructBrep(Brep=loft_3)  # -> Faces, Edges, Vertices
crv = Curve(debrep_2.Edges)
arrpolar = PolarArray(Geometry=pt, Plane=PlaneXY(0, 0, 0), Count=12, Angle=6.283185307)  # -> Geometry, Transform
series = Series(Start=1, Step=1, Count=12)
panel_2 = Panel(ln)
end = EndPoints(Curve=dupln_2)  # -> Start, End
int = Integer(series)
dispatch = Dispatch(List=crv, DispatchPattern=[True, False])  # -> ListA, ListB

pipe_2 = Pipe(Curve=dispatch.ListA, Radius=Slider(2, range=0.2..2), Caps=0)
preview_2 = CustomPreview(Geometry=pipe_2, Shader=ColourSwatch(SwatchColor=RGB(64, 64, 64)))

tag = TextTag(Location=arrpolar.Geometry, Text=int)
weave = Weave(Pattern=[0, 1], Stream0=end.Start, Stream1=end.End, NullGaps=False)
dispatch_2 = Dispatch(List=dispatch.ListA, DispatchPattern=[True, False])  # -> ListA, ListB
pline = PolyLine(Vertices=flatten(weave), Closed=False)
explode = Explode(Curve=pline, Recursive=True)  # -> Segments, Vertices
crv_2 = Curve(dispatch_2.ListA)
dispatch_3 = Dispatch(List=explode.Segments, DispatchPattern=[True, False])  # -> ListA, ListB
divide_2 = DivideCurve(Curve=crv_2, Count=Slider(8, range=0..100), Kinks=False)  # -> Points, Tangents, Parameters
pipe_3 = Pipe(Curve=dupln_2, Radius=1, Caps=0)  # -> flatten(Pipe)
crv_3 = Curve(dispatch_3.ListB)
pdecon = Deconstruct(Point=divide_2.Points)  # -> XComponent, YComponent, ZComponent
end_2 = EndPoints(Curve=crv_3)  # -> Start, End
preview_3 = CustomPreview(Geometry=pipe_3, Shader=ColourSwatch(SwatchColor=RGB(255, 255, 255)))
pt_2 = ConstructPoint(XCoordinate=pdecon.XComponent, YCoordinate=pdecon.YComponent, ZCoordinate=Slider(45, range=0..100))
pt_3 = ConstructPoint(XCoordinate=0, YCoordinate=0, ZCoordinate=Slider(53, range=0..100))
ln_2 = Line(StartPoint=divide_2.Points, EndPoint=pt_2)
pipe_4 = Pipe(Curve=ln_2, Radius=Slider(0.3, range=0.2..3), Caps=0)
preview_4 = CustomPreview(Geometry=pipe_4, Shader=ColourSwatch(SwatchColor=RGB(130, 130, 130)))
