# Grasshopper definition shuchov.gh (Grasshopper 0.9.76)

number_slider = Slider(26, range=1..50)
crv = Curve(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)
crv_2 = Curve(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)
divide = DivideCurve(Curve=crv_2, Count=number_slider, Kinks=False)  # -> Points, Tangents, Parameters
divide_2 = DivideCurve(Curve=crv, Count=number_slider, Kinks=False)  # -> Points, Tangents, Parameters
C = Closed(True)
shift = ShiftList(List=divide.Points, Shift=Slider(9, range=0..40), Wrap=True)
pline = PolyLine(Vertices=divide_2.Points, Closed=C)
pline_2 = PolyLine(Vertices=divide.Points, Closed=C)
ln = Line(StartPoint=divide_2.Points, EndPoint=shift)
explode = Explode(Curve=flatten([pline, pline_2]), Recursive=True)  # -> Segments, Vertices
mirror = Mirror(Geometry=ln, Plane=PlaneYZ(0, 0, 0))  # -> Geometry, Transform
crv_3 = Curve(reparameterize(flatten([mirror.Geometry, ln])))
mcx = MultipleCurves(Curves=flatten(crv_3))  # -> Points, IndexA, IndexB, ParamA, ParamB
panel = Panel(mcx.IndexA)
shatter = Shatter(Curve=crv_3, Parameters=mcx.ParamA)
crv_4 = Curve(reparameterize(flatten([explode.Segments, shatter])))
