# Grasshopper definition subdivision.gh (Grasshopper 0.9.76)
# plug-ins: Weaverbird

mesh = Mesh(<mesh referenced from the Rhino model>)
wbjoin = WeaverbirdsJoinMeshesAndWeld(Mesh=mesh, Weld=False)
wbcatmullclark = WeaverbirdsCatmullClarkSubdivision(MeshCurves=wbjoin, Level=Slider(3, range=0..10), SmoothNakedEdges=1)
