# Grasshopper definition test_3_0.9.gh (Grasshopper 0.9.76)
# plug-ins: MeshEdit Components, Weaverbird, calabiYau

number_slider = Slider(4, range=0..10)
number_slider_2 = Slider(100, range=0..100)
number_slider_3 = Slider(6, range=0..10)
cy = CalabiYau(
    Dimension=Slider(3, range=0..10),
    Degree=Slider(0.9, range=0..1),
    Subdiv=Slider(2, range=0..10),
    SubdivV=Slider(32, range=0..100))
wbedges = WeaverbirdsMeshEdges(MeshOrPolylines=cy)
mjoin = MeshJoin(Meshes=cy)
weldvertices = MeshWeldVertices(Mesh=mjoin, Tolerance=0.3)  # -> RuntimeMessage, Mesh
mesh = Mesh(weldvertices.Mesh)
wbcatmullclark = WeaverbirdsCatmullClarkSubdivision(MeshCurves=mesh, Level=Slider(3, range=0..10), SmoothNakedEdges=1)
