# Grasshopper definition tori2moebius2.gh (Grasshopper 0.9.76)
# plug-ins: Kangaroo Components

number_slider = Slider(60, range=4..100)
width = Slider(20, range=0..20)
crv = Curve([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])
crv_2 = Curve([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])
cir = Circle(Plane=PlaneXY(0, 0, 0), Radius=Slider(50, range=4..100))
pframes = PerpFrames(Curve=cir, Count=number_slider, Align=True)  # -> Frames, Parameters
division = Division(A=Slider(1, range=1..5), B=2)
cir_2 = Circle(Plane=pframes.Frames, Radius=width)
loft = Loft(Curves=cir_2, Options={Adjust=False, Closed=True, LoftEnds=0, LoftSimp=0, LoftType=0, Rebuild=10, Refit=0.01})
range = Range(Domain=division, Steps=number_slider)
bbox = BoundingBox(Content=cir_2, Plane=PlaneXY(0, 0, 0), UnionBox=True)  # -> Box, Box_2
addition = Addition(A=range, B=0.5)
item = ListItem(List=cir_2, Index=0, Wrap=True)
debrep = DeconstructBrep(Brep=bbox.Box_2)  # -> Faces, Edges, Vertices
mod = Modulus(A=addition, B=1)
mod_2 = Modulus(A=range, B=1)
loft_2 = Loft(Curves=cir_2, Options={Adjust=False, Closed=True, LoftEnds=0, LoftSimp=0, LoftType=0, Rebuild=10, Refit=0.01})
item_2 = ListItem(List=debrep.Edges, Index=0, Wrap=True)
eval = EvaluateCurve(Curve=reparameterize([cir_2, item]), Parameter=mod_2)  # -> Point, Tangent, Angle
vec = Vector(cir_2)
eval_2 = EvaluateCurve(Curve=reparameterize([cir_2, item]), Parameter=mod)  # -> Point, Tangent, Angle
len = Length(Curve=item_2)
extr = Extrude(Base=cir_2, Direction=vec)
ln = Line(StartPoint=eval.Point, EndPoint=eval_2.Point)
panel = Panel(ln)
panel_2 = Panel(len)
addition_2 = Addition(A=number_slider, B=1)
cap = CapHoles(Brep=extr)
divide = DivideCurve(Curve=ln, Count=10, Kinks=False)  # -> Points, Tangents, Parameters
loft_3 = Loft(Curves=ln, Options={Adjust=False, Closed=False, LoftEnds=0, LoftSimp=0, LoftType=0, Rebuild=10, Refit=0.01})
debrep_2 = DeconstructBrep(Brep=loft_3)  # -> Faces, Edges, Vertices
dupln = RemoveDuplicateLines(Lines=ln, Tolerance=0.01)
crv_3 = Curve(debrep_2.Edges)
dispatch = Dispatch(List=crv_3, DispatchPattern=[True, False])  # -> ListA, ListB
pipe = Pipe(Curve=dispatch.ListA, Radius=Slider(3, range=0.2..3), Caps=0)
preview = CustomPreview(Geometry=pipe, Shader=ColourSwatch(SwatchColor=RGB(64, 64, 64)))
end = EndPoints(Curve=dupln)  # -> Start, End
preview_2 = CustomPreview(Geometry=cap, Shader=ColourSwatch(SwatchColor=RGBA(255, 255, 255, 62)))
weave = Weave(Pattern=[0, 1], Stream0=end.Start, Stream1=end.End, NullGaps=False)
dispatch_2 = Dispatch(List=dispatch.ListA, DispatchPattern=[True, False])  # -> ListA, ListB
pline = PolyLine(Vertices=flatten(weave), Closed=False)
explode = Explode(Curve=pline, Recursive=True)  # -> Segments, Vertices
crv_4 = Curve(dispatch_2.ListA)
dispatch_3 = Dispatch(List=explode.Segments, DispatchPattern=[True, False])  # -> ListA, ListB
divide_2 = DivideCurve(Curve=crv_4, Count=Slider(8, range=0..100), Kinks=False)  # -> Points, Tangents, Parameters
crv_5 = Curve(dispatch_3.ListB)
pdecon = Deconstruct(Point=divide_2.Points)  # -> XComponent, YComponent, ZComponent
end_2 = EndPoints(Curve=crv_5)  # -> Start, End
pt = ConstructPoint(XCoordinate=pdecon.XComponent, YCoordinate=pdecon.YComponent, ZCoordinate=Slider(45, range=0..100))
pt_2 = ConstructPoint(XCoordinate=0, YCoordinate=0, ZCoordinate=Slider(100, range=0..100))
ln_2 = Line(StartPoint=divide_2.Points, EndPoint=pt)
pipe_2 = Pipe(Curve=ln_2, Radius=Slider(0.3, range=0.2..3), Caps=0)
preview_3 = CustomPreview(Geometry=pipe_2, Shader=ColourSwatch(SwatchColor=RGB(130, 130, 130)))
