# Grasshopper definition vasiliy.gh (Grasshopper 0.9.76)
# plug-ins: LunchBox, calabiYau

number_slider = Slider(10, range=0..10)
number_slider_2 = Slider(1, range=0..1)
number_slider_3 = Slider(10, range=0..10)
number_slider_4 = Slider(3, range=0..10)
range = Range(Domain=Domain(0, 1), Steps=Slider(99, range=0..100))
cy = CalabiYau(Dimension=number_slider_4, Degree=range)  # -> simplify(CalabiYau)
cy_2 = CalabiYau(Dimension=number_slider_4, Degree=Slider(0.9, range=0..1))  # -> simplify(CalabiYau)
sqgrid = Square(
    Plane=PlaneXY(0, 0, 0),
    Size=Slider(400, range=0..1000),
    ExtentX=expr("x-1", number_slider),
    ExtentY=expr("x-1", number_slider))  # -> Cells, flatten(Points)
pt = Point(simplify(graft(sqgrid.Points)))
move = Move(Geometry=cy, Motion=pt)  # -> Geometry, Transform
bake = ObjectBake(
    BakeToggle=Button(),
    GeometryObjects=move.Geometry,
    Layer="GH_Bake",
    ObjectName=graft(range),
    ObjectColor=RGB(0, 0, 0),
    LayerColor=RGB(255, 255, 255))
preview = CustomPreview(
    Geometry=move.Geometry,
    Shader={ambient=RGB(0, 0, 0), diffuse=RGB(255, 105, 180), emission=RGB(76, 32, 54), shine=0.5, specular=RGB(255, 255, 255), transparency=0})
panel = Panel(pt)
